# Grasshopper definition gh_testSite_decoupling.gh (Grasshopper 1.0.7)
# plug-ins: TableUiAdapter

trigger = Trigger(Interval=50, TimerInterval=50, Target=tableui)  # disabled
tableui = TableUiAdapterComponent(Link="5005", Run=Toggle(True))  # -> Points, Ids, Rotation, Types
brep = Brep(<brep referenced from the Rhino model>)
panel = Panel(tableui.Types)
panel_2 = Panel(tableui.Points)
move = Move(Geometry=brep, Motion=tableui.Points)  # -> Geometry, Transform
rotate = Rotate(Geometry=move.Geometry, Angle=tableui.Rotation, Plane=tableui.Points)  # -> Geometry, Transform
